# Grasshopper definition N-gon cone - Exercise.gh (Grasshopper 1.0.7)

top_r = Slider(2, range=0..10)
H = Slider(7, range=0..10)
bottom_r = Slider(7, range=0..10)
N = Slider(9, range=3..12)
division = Division(A="360", B=N)
addition = Addition(A=N, B="1")
construct_point = ConstructPoint(XCoordinate=top_r, YCoordinate=0, ZCoordinate=H)
construct_point_2 = ConstructPoint(XCoordinate=bottom_r, YCoordinate=0, ZCoordinate=0)
construct_point_3 = ConstructPoint(XCoordinate=0, YCoordinate=0, ZCoordinate=0)
unit_z = UnitZ(Factor=1)
series = Series(Start=0, Step=division, Count=addition)
line_sdl = LineSDL(Start=construct_point_3, Direction=unit_z, Length=1)
rotate_axis = RotateAxis(Geometry=construct_point, Angle=degrees(series), Axis=line_sdl)  # -> Geometry, Transform
rotate_axis_2 = RotateAxis(Geometry=construct_point_2, Angle=degrees(series), Axis=line_sdl)  # -> Geometry, Transform
polyline = PolyLine(Vertices=rotate_axis.Geometry, Closed=False)
polyline_2 = PolyLine(Vertices=rotate_axis_2.Geometry, Closed=False)
line = Line(StartPoint=rotate_axis.Geometry, EndPoint=rotate_axis_2.Geometry)
