# Grasshopper definition 01-basics.gh (Grasshopper 1.0.7)

point = Point(<point referenced from the Rhino model>)
point_2 = Point(<point referenced from the Rhino model>)
point_3 = Point([<point referenced from the Rhino model> x4])
deconstruct = Deconstruct(Point=point)  # -> XComponent, YComponent, ZComponent
deconstruct_2 = Deconstruct(Point=point_2)  # -> XComponent, YComponent, ZComponent
deconstruct_3 = Deconstruct(Point=point_3)  # -> XComponent, YComponent, ZComponent
average = Average(Input=point_3)
list_length = ListLength(List=point_3)
addition = Addition(A=deconstruct.XComponent, B=deconstruct_2.XComponent)
addition_2 = Addition(A=deconstruct.YComponent, B=deconstruct_2.YComponent)
addition_3 = Addition(A=deconstruct.ZComponent, B=deconstruct_2.ZComponent)
mass_addition = MassAddition(Input=deconstruct_3.XComponent)  # -> Result, PartialResults
mass_addition_2 = MassAddition(Input=deconstruct_3.YComponent)  # -> Result, PartialResults
mass_addition_3 = MassAddition(Input=deconstruct_3.ZComponent)  # -> Result, PartialResults
panel = Panel(average)
division = Division(A=addition_3, B=2)
division_2 = Division(A=addition, B=2)
division_3 = Division(A=addition_2, B=2)
division_4 = Division(A=mass_addition.Result, B=list_length)
division_5 = Division(A=mass_addition_2.Result, B=list_length)
division_6 = Division(A=mass_addition_3.Result, B=list_length)
center_box = CenterBox(Base=PlaneXY(0, 0, 0), X=panel, Y=panel, Z=panel)
construct_point = ConstructPoint(XCoordinate=division_2, YCoordinate=division_3, ZCoordinate=division)
construct_point_2 = ConstructPoint(XCoordinate=division_4, YCoordinate=division_5, ZCoordinate=division_6)
unit_z = UnitZ(Factor=Slider(5, range=1..19))
move = Move(Geometry=construct_point_2, Motion=unit_z)  # -> Geometry, Transform
