# Grasshopper definition 02-sinewave.gh (Grasshopper 1.0.7)

series = Series(Start=0, Step=Slider(0.2, range=0..10), Count=Slider(93, range=0..100))
sine = Sine(Value=series)
multiplication = Multiplication(A=sine, B=Slider(10, range=0..10))
construct_point = ConstructPoint(XCoordinate=series, YCoordinate=0, ZCoordinate=multiplication)
polyline = PolyLine(Vertices=construct_point, Closed=False)

point = Point(<point referenced from the Rhino model>)  # disabled
point_2 = Point(<point referenced from the Rhino model>)  # disabled
brep = Brep(<brep referenced from the Rhino model>)  # disabled
line = Line(StartPoint=point, EndPoint=point_2)  # disabled
vector_2pt = Vector2Pt(PointA=point, PointB=point_2, Unitize=False)  # -> Vector, Length; disabled
move = Move(Geometry=brep, Motion=vector_2pt.Vector)  # -> Geometry, Transform; disabled

number_slider = Slider(100, range=0..100)
addition = Addition(A=number_slider, B="1")
curve = Curve(<curve referenced from the Rhino model>)
series_2 = Series(Start=0, Step=Slider(24, range=0..100), Count=addition)
divide_curve = DivideCurve(Curve=curve, Count=number_slider, Kinks=False)  # -> Points, Tangents, Parameters
sine_2 = Sine(Value=degrees(series_2))
unit_z = UnitZ(Factor=sine_2)
move_2 = Move(Geometry=divide_curve.Points, Motion=unit_z)  # -> Geometry, Transform
line_2 = Line(StartPoint=divide_curve.Points, EndPoint=move_2.Geometry)
polyline_2 = PolyLine(Vertices=move_2.Geometry, Closed=False)
