# Grasshopper definition 03-helix.gh (Grasshopper 1.0.7)

number_slider = Slider(4, range=0..10)
number_slider_2 = Slider(26, range=0..100)
negative = Negative(Value=number_slider)
construct_point = ConstructPoint(XCoordinate=0, YCoordinate=0, ZCoordinate=0)
construct_point_2 = ConstructPoint(XCoordinate=number_slider, YCoordinate=0, ZCoordinate=0)
construct_point_3 = ConstructPoint(XCoordinate=negative, YCoordinate=0, ZCoordinate=0)
series = Series(Start=0, Step=Slider(0.76, range=0..1), Count=number_slider_2)
line_sdl = LineSDL(Start=construct_point, Direction=Vector(0, 0, 1), Length=1)
unit_z = UnitZ(Factor=series)
line = Line(StartPoint=construct_point_2, EndPoint=construct_point_3)
move = Move(Geometry=line, Motion=unit_z)  # -> Geometry, Transform
series_2 = Series(Start=0, Step=Slider(14, range=0..360), Count=number_slider_2)
rotate_axis = RotateAxis(Geometry=move.Geometry, Angle=degrees(series_2), Axis=line_sdl)  # -> Geometry, Transform
end_points = EndPoints(Curve=rotate_axis.Geometry)  # -> Start, End
polyline = PolyLine(Vertices=end_points.Start, Closed=False)
polyline_2 = PolyLine(Vertices=end_points.End, Closed=False)

number_slider_3 = Slider(3, range=0..10)
polygon = Polygon(Plane=PlaneXY(0, 0, 0), Radius=Slider(7, range=0..10), Segments=number_slider_3, FilletRadius=0)  # -> Polygon, Length
polygon_2 = Polygon(Plane=PlaneXY(0, 0, 0), Radius=Slider(18, range=0..100), Segments=number_slider_3, FilletRadius=0)  # -> Polygon, Length
unit_z_2 = UnitZ(Factor=Slider(12, range=0..100))
move_2 = Move(Geometry=polygon.Polygon, Motion=unit_z_2)  # -> Geometry, Transform
explode = Explode(Curve=move_2.Geometry, Recursive=True)  # -> Segments, Vertices
explode_2 = Explode(Curve=polygon_2.Polygon, Recursive=True)  # -> Segments, Vertices
line_2 = Line(StartPoint=explode.Vertices, EndPoint=explode_2.Vertices)
