# Grasshopper definition 04-mobius.gh (Grasshopper 1.0.7)

construct_domain = ConstructDomain(DomainStart="0", DomainEnd="360")
construct_point = ConstructPoint(XCoordinate=Slider(5, range=0..10), YCoordinate=0, ZCoordinate=0)
range = Range(Domain=construct_domain, Steps=Slider(9, range=0..100))
rotate = Rotate(Geometry=construct_point, Angle=degrees(range), Plane=PlaneXY(0, 0, 0))  # -> Geometry, Transform
polyline = PolyLine(Vertices=rotate.Geometry, Closed=False)

number_slider = Slider(5, range=0..100)
curve = Curve(<curve referenced from the Rhino model>)
domain = Domain(curve)
range_2 = Range(Domain=domain, Steps=number_slider)
perp_frame = PerpFrame(Curve=curve, Parameter=range_2)
divide_curve = DivideCurve(Curve=curve, Count=number_slider, Kinks=False)  # -> Points, Tangents, Parameters

perp_frame_2 = PerpFrame(Curve=curve, Parameter=Slider(22, range=0..100))
deconstruct_domain = DeconstructDomain(Domain=curve)  # -> Start, End
length = Length(Curve=curve)
panel = Panel(deconstruct_domain.End)
panel_2 = Panel(length)

number_slider_2 = Slider(100, range=0..100)
circle = Circle(Plane=PlaneXY(0, 0, 0), Radius=Slider(25, range=0..50))
radians = Radians(Degrees=Slider(65, range=0..360))
point = Point([<point referenced from the Rhino model> x10])
divide_curve_2 = DivideCurve(Curve=circle, Count=number_slider_2, Kinks=False)  # -> Points, Tangents, Parameters
polyline_2 = PolyLine(Vertices=point, Closed=False)
interpolate = Interpolate(Vertices=point, Degree=Slider(3, range=1..11), Periodic=Toggle(False), KnotStyle=1)  # -> Curve, Length, Domain
nurbs_curve = NurbsCurve(Vertices=point, Degree=Slider(3, range=0..10), Periodic=Toggle(False))  # -> Curve, Length, Domain
kinky_curve = KinkyCurve(Vertices=point, Degree=3, Angle=radians)  # -> Curve, Length, Domain
perp_frame_3 = PerpFrame(Curve=circle, Parameter=0)
perp_frame_4 = PerpFrame(Curve=circle, Parameter=divide_curve_2.Parameters)
vector_display = VectorDisplay(Anchor=perp_frame_4, Vector=divide_curve_2.Tangents)
insert_items = InsertItems(List=perp_frame_4, Item=perp_frame_3, Indices=number_slider_2, Wrap=True)
number_slider_3 = Slider(7, range=0..10)
deconstruct_plane = DeconstructPlane(Plane=insert_items)  # -> Origin, XAxis, YAxis, ZAxis
reverse = Reverse(Vector=deconstruct_plane.XAxis)
amplitude = Amplitude(Vector=deconstruct_plane.XAxis, Amplitude=number_slider_3)
move = Move(Geometry=deconstruct_plane.Origin, Motion=amplitude)  # -> Geometry, Transform
amplitude_2 = Amplitude(Vector=reverse, Amplitude=number_slider_3)
move_2 = Move(Geometry=deconstruct_plane.Origin, Motion=amplitude_2)  # -> Geometry, Transform
line = Line(StartPoint=move.Geometry, EndPoint=move_2.Geometry)
multiplication = Multiplication(A="180", B=Slider(3, range=0..10))
construct_domain_2 = ConstructDomain(DomainStart=0, DomainEnd=multiplication)
range_3 = Range(Domain=construct_domain_2, Steps=number_slider_2)
rotate_2 = Rotate(Geometry=line, Angle=degrees(range_3), Plane=insert_items)  # -> Geometry, Transform
end_points = EndPoints(Curve=rotate_2.Geometry)  # -> Start, End
polyline_3 = PolyLine(Vertices=end_points.End, Closed=False)
polyline_4 = PolyLine(Vertices=end_points.Start, Closed=False)
