# Grasshopper definition 05-attractor.gh (Grasshopper 1.0.7)

number_slider = Slider(1.4, range=0..10)
number_slider_2 = Slider(28, range=0..100)
square = Square(Plane=PlaneXY(0, 0, 0), Size=number_slider, ExtentX=number_slider_2, ExtentY=number_slider_2)  # -> Cells, Points
curve = Curve(<curve referenced from the Rhino model>)
curve_closest_point = CurveClosestPoint(Point=square.Points, Curve=curve)  # -> Point, Parameter, Distance
distance = Distance(PointA=square.Points, PointB=curve_closest_point.Point)
division = Division(A=distance, B=Slider(8, range=0..100))
division_2 = Division(A=number_slider, B=2)
minimum = Minimum(A=division, B=division_2)
circle = Circle(Plane=square.Points, Radius=minimum)

number_slider_3 = Slider(4.2, range=0..10)
number_slider_4 = Slider(25, range=0..100)
square_2 = Square(Plane=PlaneXY(0, 0, 0), Size=number_slider_3, ExtentX=number_slider_4, ExtentY=number_slider_4)  # -> Cells, Points
point = Point(<point referenced from the Rhino model>)
point_2 = Point(square_2.Points)
distance_2 = Distance(PointA=point_2, PointB=point)
division_3 = Division(A=distance_2, B=Slider(27, range=0..100))
division_4 = Division(A=number_slider_3, B=2)
minimum_2 = Minimum(A=division_3, B=division_4)
circle_2 = Circle(Plane=point_2, Radius=minimum_2)
panel = Panel(distance_2)
