# Grasshopper definition 07-bridge-project.gh (Grasshopper 1.0.7)

number_slider = Slider(23, range=0..100)
number_slider_2 = Slider(7, range=0..10)
depth = Slider(10, range=0..10)
height = Slider(10, range=0..10)
construct_point = ConstructPoint(XCoordinate=number_slider, YCoordinate=0, ZCoordinate=0)
negative = Negative(Value=number_slider_2)
construct_point_2 = ConstructPoint(XCoordinate=number_slider, YCoordinate=number_slider_2, ZCoordinate=height)
construct_point_3 = ConstructPoint(XCoordinate=number_slider, YCoordinate=negative, ZCoordinate=height)
center_box = CenterBox(Base=construct_point, X=depth, Y=Slider(10, range=0..10), Z=height)
yz_plane = YZPlane(Origin=Point(0, 0, 0))
mirror = Mirror(Geometry=center_box, Plane=yz_plane)  # -> Geometry, Transform
line = Line(StartPoint=construct_point_2, EndPoint=construct_point_3)
mirror_2 = Mirror(Geometry=line, Plane=yz_plane)  # -> Geometry, Transform
loft = Loft(
    Curves=[mirror_2.Geometry, line],
    Options={Adjust=False, Closed=False, LoftEnds=0, LoftSimp=0, LoftType=0, Rebuild=10, Refit=0.01})
